# Grasshopper definition Assignment3.gh (Grasshopper 1.0.7)
# Copyright: Creative commons license
# plug-ins: Kangaroo2 Components

# ---- group: RH_IN:radius1
number_slider = Slider(10, range=1..20)

# ----
pt = ConstructPoint(XCoordinate=0, YCoordinate=0, ZCoordinate=0)

# ---- group: RH_IN:loops
number_slider_2 = Slider(48, range=1..100)

# ---- group: RH_IN:seed
number_slider_3 = Slider(1, range=1..5)

# ----
sph = Sphere(Base=pt, Radius=number_slider)
bbox = BoundingBox(Content=sph, Plane=PlaneXY(0, 0, 0), UnionBox=True)  # -> Box, Box_2
pop3d = Populate3D(Region=bbox.Box, Count=number_slider_2, Seed=number_slider_3)

# ---- group: RH_IN:planedir
number_slider_4 = Slider(0.5, range=0..1)

# ----
ln = Line(StartPoint=pt, EndPoint=pop3d)
list = ValueList({"1st": 0, "2nd": 0.2, "3rd": 0.4, "4th": 0.6, "5th": 0.85, "6th": 1.0}, selected="4th")  # disabled
pframe = PerpFrame(Curve=ln, Parameter=number_slider_4)
toggle = BooleanToggle(False)  # disabled

# ---- group: RH_IN:radius2
number_slider_5 = Slider(0.1, range=0.1..0.4)

# ----
sec = BrepPlane(Brep=sph, Plane=pframe)  # -> Curves, Points
panel = Panel("""0.2
0.4""")  # disabled
item = ListItem(List=panel, Index=toggle, Wrap=True)  # disabled
mp = MultiPipe(Curves=flatten(sec.Curves), NodeSize=0.5, EndOffset=1, StrutSize=number_slider_5, Segment=0, KinkAngle=0.6, CubeFit=0)
meshsubd = MeshFromSubD(SubD=mp, Density=2)
medges = MeshEdges(Mesh=meshsubd)  # -> NakedEdges, InteriorEdges, NonManifoldEdges

# ---- group: RH_OUT:edges
crv = Curve(medges.InteriorEdges)

# ---- group: RH_OUT:mesh
mesh = Mesh(meshsubd)
